# Grasshopper definition Elliptical Dome.gh (Grasshopper 0.9.72)

# ---- group: GLAZING HEIGHT
int = Integer(2000)

# ----
brep = Brep(<brep referenced from the Rhino model>)
brep_2 = Brep([<brep referenced from the Rhino model> x22])
brep_3 = Brep(<brep referenced from the Rhino model>)
cluster = Cluster_8(glazing_height=int, B=brep)
cluster_2 = Cluster(B=brep_2)
cluster_3 = Cluster_2(B=brep_3)
int_2 = Integer(-500)
pt = Point(cluster_2)
crv = Curve(cluster_3)
Z = UnitZ(Factor=int_2)
cluster_4 = Cluster_3(D=pt)
avr = Average(Input=flatten(pt))
crv_2 = Curve(cluster)
move = Move(Geometry=avr, Motion=Z)  # -> Geometry, Transform
y_extent = Panel(cluster_4)
flip = FlipCurve(Curve=crv_2)  # -> Curve, Flag
int_3 = Integer(94400)
int_4 = Integer(21200)
int_5 = Integer(15000)
int_6 = Integer(30000)

xy = XYPlane(Origin=move.Geometry)
division = Division(A=int_3, B=2)
division_2 = Division(A=int_4, B=2)
darc = DeconstructArc(Arc=crv)  # -> BasePlane, Radius, Angle
division_3 = Division(A=int_6, B=2)
division_4 = Division(A=int_5, B=2)
xy_2 = XYPlane(Origin=darc.BasePlane)
ellipse = Ellipse(Plane=xy, Radius1=division, Radius2=division_2)  # -> Ellipse, Focus1, Focus2
ellipse_2 = Ellipse(Plane=xy_2, Radius1=division_3, Radius2=division_4)  # -> Ellipse, Focus1, Focus2
cir = Circle(Plane=xy_2, Radius=darc.Radius)

# ---- group: ELLIPSE
crv_3 = Curve(flip.Curve)

# ---- group: OCULUS
circle = Circle(cir)

# ---- group: QTY RADIALS
number_slider = Slider(64, range=10..140)

# ---- group: MINOR RADIUS
number_slider_2 = Slider(17000, range=1000..20000)

# ---- group: FUNNEL: OCULUS OFFSET
number_slider_3 = Slider(3000, range=1000..10000)

# ---- group: DOME HEIGHT
number_slider_4 = Slider(5000, range=1000..10000)

# ---- group: FUNNEL: QTY LOFT CURVES
number_slider_5 = Slider(32, range=10..140)

# ---- group: SCALE FACTOR
num = Number(2.5)

# ---- group: ELLIPSE
crv_4 = Curve(crv_3)

# ---- group: OCULUS
circle_2 = Circle(circle)

# ---- group: ELLIPSE
crv_5 = Curve(crv_3)

# ---- group: INITAL DOME: QTY LOFT CURVES
int_7 = Integer(120)

# ---- group: OCULUS
circle_3 = Circle(circle)

# ---- group: MINOR ELLIPSE
crv_6 = Curve(ellipse_2.Ellipse)

# ---- group: FUNNEL CURVE DIV LENGTH
int_8 = Integer(1000)

# ----
Z_2 = UnitZ(Factor=11000)
Z_3 = UnitZ(Factor=3000)

# ----
# INITIAL DOME
area = Area(Geometry=crv_5)  # -> Area, Centroid
divide = DivideCurve(Curve=crv_5, Count=int_7, Kinks=False)  # -> Points, Tangents, Parameters
Z_4 = UnitZ(Factor=number_slider_4)
move_2 = Move(Geometry=area.Centroid, Motion=Z_4)  # -> Geometry, Transform
pshift = ShiftPaths(Data=divide.Points, Offset=-1)
vec2pt = Vector2Pt(PointA=move_2.Geometry, PointB=pshift, Unitize=False)  # -> Vector, Length
devec = DeconstructVector(Vector=vec2pt.Vector)  # -> XComponent, YComponent, ZComponent
vec = VectorXYZ(XComponent=devec.XComponent, YComponent=devec.YComponent, ZComponent=0)  # -> Vector, Length
loft_opt = LoftOptions(Closed=True, Adjust=False, Rebuild=0, Refit=0, Type=0)
arc = ArcSED(Start=move_2.Geometry, End=pshift, Direction=vec.Vector)  # -> Arc, Plane, Radius
loft = Loft(Curves=arc.Arc, Options=loft_opt)

cluster_5 = Cluster_4(qty_radials=number_slider, r2=number_slider_2, scale_factor=num, ellipse_curve=crv_4, oculus_curve=circle_2)  # -> diagrid_ellipse_2, diagrid_radial_2
move_3 = Move(Geometry=circle_3, Motion=Z_2)  # -> Geometry, Transform
move_4 = Move(Geometry=circle_3, Motion=Z_3)  # -> Geometry, Transform

# ---- group: RADIAL DIVISIONS
number_slider_6 = Slider(40, range=10..40)

# ----
preview = CustomPreview(Geometry=cluster_5.diagrid_ellipse_2, Shader=ColourSwatch(SwatchColor=RGB(0, 255, 106)))

divide_2 = DivideCurve(Curve=cluster_5.diagrid_radial_2, Count=number_slider_6, Kinks=False)  # -> Points, Tangents, Parameters
relitem = RelativeItem(Tree=divide_2.Points, Offset="{0;1}(1)", WrapPaths=True, WrapItems=False)  # -> ItemA, ItemB
relitem_2 = RelativeItem(Tree=divide_2.Points, Offset="{0;1}(-1)", WrapPaths=True, WrapItems=False)  # -> ItemA, ItemB
ln = Line(StartPoint=relitem.ItemA, EndPoint=relitem.ItemB)
ln_2 = Line(StartPoint=relitem_2.ItemA, EndPoint=relitem_2.ItemB)
merge = Merge(Data1=ln, Data2=ln_2)

dome_surface_basic = Surface(loft)
cluster_6 = Cluster_7(
    dome_surface_basic=dome_surface_basic,
    oculus_upturn=move_3.Geometry,
    oculus_downturn=move_4.Geometry,
    minor_ellipse=crv_6,
    funnel_curve_div_length=int_8,
    upturn_taper_width=Slider(500, range=0..1000),
    upturn_taper_height=Slider(14369, range=10000..20000),
    oculus_xy_offset=number_slider_3,
    qty_basic_loft_curves=number_slider_5)  # -> funnel_curves_upturn_4, funnel_curves_downturn_4, oculus_slope_2, v_planes_center_2
panel = Panel(cluster_6.oculus_slope_2)

# ---- group: ELLIPSE
crv_7 = Curve(crv_3)

# ----
crv_8 = Curve(cluster_6.funnel_curves_upturn_4)
crv_9 = Curve(cluster_6.funnel_curves_downturn_4)
srf = Surface(cluster_6.v_planes_center_2)

# ---- group: DIAGRID 'V' START
int_9 = Integer(4)

# ---- group: DIAGRID 'U'
V = VCount(120)

# ---- group: DIAGRID 'V'
V_2 = VCount(48)

# ----
cluster_7 = Cluster_5(funnel_curves=crv_9, B=srf, U=V, V=V_2, _1st_v=int_9)  # -> dome_surface_basic_2, dome_surface_uniform_2, panel_frames, edge_frames, cenpoints, cenpoints_edge, surfaces, funnel_curves_4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
cluster_8 = Cluster_5(funnel_curves=crv_8, B=srf, U=V, V=V_2, _1st_v=int_9)  # -> dome_surface_basic_2, dome_surface_uniform_2, panel_frames, edge_frames, cenpoints, cenpoints_edge, surfaces, funnel_curves_4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; disabled
srf_2 = Surface(cluster_7.dome_surface_uniform_2)
srf_3 = Surface(cluster_7.surfaces)
crv_10 = Curve(cluster_7.funnel_curves_4)
srf_4 = Surface(cluster_8.dome_surface_uniform_2)
srf_5 = Surface(cluster_8.surfaces)
crv_11 = Curve(cluster_8.funnel_curves_4)
merge_2 = Merge(
    Data1=flatten(cluster_7.panel_frames),
    Data2=flatten(cluster_7.edge_frames_seam_2),
    Data3=flatten(cluster_7.edge_frames_oculus_2))
merge_3 = Merge(
    Data1=flatten(cluster_7.cenpoints),
    Data2=flatten(cluster_7.edge_center_pts_seam_2),
    Data3=flatten(cluster_7.edge_center_pts_oculus_2))
merge_4 = Merge(
    Data1=flatten(cluster_8.panel_frames),
    Data2=flatten(cluster_8.edge_frames_seam_2),
    Data3=flatten(cluster_8.edge_frames_oculus_2))
merge_5 = Merge(
    Data1=flatten(cluster_8.cenpoints),
    Data2=flatten(cluster_8.edge_center_pts_seam_2),
    Data3=flatten(cluster_8.edge_center_pts_oculus_2))

# ---- group: ELLIPSE
crv_12 = Curve(crv_7)

# ----
srf_6 = Surface(srf_2)
loft_opt_2 = LoftOptions(Closed=True, Adjust=False, Rebuild=0, Refit=0, Type=0)
cull = CullPattern(List=flatten(crv_10), CullPattern=[False, True])
loft_opt_3 = LoftOptions(Closed=True, Adjust=False, Rebuild=0, Refit=0, Type=0)
cull_2 = CullPattern(List=flatten(crv_11), CullPattern=[False, True])
project = Project(Curve=crv_12, Brep=srf_6, Direction=Vector(0, 0, 1))  # disabled

disc = Discontinuity(Curve=merge_2, Level=1)  # -> Points, Parameters
disc_2 = Discontinuity(Curve=merge_4, Level=1)  # -> Points, Parameters
Z_5 = UnitZ(Factor=-10000)
Z_6 = UnitZ(Factor=40000)
move_5 = Move(Geometry=crv_12, Motion=Z_5)  # -> Geometry, Transform
extr = Extrude(Base=move_5.Geometry, Direction=Z_6)
cap = CapHoles(Brep=extr)
brepinc = PointInBrep(Brep=cap, Point=disc.Points, Strict=False)
brepinc_2 = PointInBrep(Brep=cap, Point=disc_2.Points, Strict=False)
ma = MassAddition(Input=brepinc)  # -> Result, PartialResults
ma_2 = MassAddition(Input=brepinc_2)  # -> Result, PartialResults
larger = LargerThan(FirstNumber=ma.Result, SecondNumber=0)  # -> flatten(LargerThan), OrEqualTo
larger_2 = LargerThan(FirstNumber=ma_2.Result, SecondNumber=0)  # -> flatten(LargerThan), OrEqualTo

loft_2 = Loft(Curves=cull, Options=loft_opt_2)
loft_3 = Loft(Curves=cull_2, Options=loft_opt_3)
srfsplit = SurfaceSplit(Surface=srf_6, Curves=project)
item = ListItem(List=srfsplit, Index=0, Wrap=True)
swatch = ColourSwatch(SwatchColor=RGB(255, 255, 255))

Z_7 = UnitZ(Factor=-10000)
Z_8 = UnitZ(Factor=40000)
move_6 = Move(Geometry=crv_12, Motion=Z_7)  # -> Geometry, Transform
extr_2 = Extrude(Base=move_6.Geometry, Direction=Z_8)
explode = Explode(Curve=merge_2, Recursive=True)  # -> Segments, Vertices
explode_2 = Explode(Curve=merge_4, Recursive=True)  # -> Segments, Vertices
cap_2 = CapHoles(Brep=extr_2)
line = Line(explode.Segments)
line_2 = Line(explode_2.Segments)
trim = TrimWithBrep(Curve=line, Brep=cap_2)  # -> Inside, Outside; disabled
trim_2 = TrimWithBrep(Curve=line_2, Brep=cap_2)  # -> Inside, Outside
crv_13 = Curve(trim.Inside)
crv_14 = Curve(trim_2.Inside)
preview_2 = CustomPreview(Geometry=crv_13, Shader=swatch)
preview_3 = CustomPreview(Geometry=crv_14, Shader=swatch)

preview_4 = CustomPreview(Geometry=cull, Shader=swatch)
preview_5 = CustomPreview(Geometry=cull_2, Shader=swatch)

cull_3 = CullPattern(List=merge_2, CullPattern=larger.LargerThan)
cull_4 = CullPattern(List=merge_3, CullPattern=larger.LargerThan)
lng = ListLength(List=cull_4)
division_5 = Division(A=lng, B=2)
int_10 = Integer(0)
subtraction = Subtraction(A=division_5, B=1)
addition = Addition(A=division_5, B=subtraction)
dom = ConstructDomain(DomainStart=int_10, DomainEnd=subtraction)
subset = SubList(List=cull_3, Domain=dom, Wrap=True)  # -> List, Index
subset_2 = SubList(List=cull_4, Domain=dom, Wrap=True)  # -> List, Index

dom_2 = ConstructDomain(DomainStart=-8000, DomainEnd=8000)
dom_3 = ConstructDomain(DomainStart=-6000, DomainEnd=6000)
num_2 = Number(0.01)
dom_4 = ConstructDomain(DomainStart=0, DomainEnd=2)
dom_5 = ConstructDomain(DomainStart=division_5, DomainEnd=addition)

# ---- group: REVEAL WIDTH
num_3 = Number(50)
neg = Negative(Value=num_3)

# ----
division_6 = Division(A=neg, B=2)
crv_15 = Curve(move_4.Geometry)

# ---- group: OCULUS
circle_4 = Circle(circle_3)

# ----
panel_thickness = Number(50)
brep_4 = Brep([<brep referenced from the Rhino model> x581])
brep_5 = Brep([<brep referenced from the Rhino model> x622])
edges = BrepEdges(Brep=brep_4)  # -> Naked, Interior, NonManifold
cluster_9 = Cluster_6(
    ellipse=crv_12,
    dome_surface=srf_2,
    panel_frames=subset.List,
    panel_center_pts=subset_2.List,
    reveal_width=neg,
    panel_thickness=panel_thickness)  # -> surfaces_2, curved_panels_2; disabled
join = JoinCurves(Curves=edges.Naked, Preserve=False)
brep_6 = Brep(cluster_9.curved_panels_2)
srf_7 = Surface(cluster_9.surfaces_2)

crv_16 = Curve(cluster_7.edge_frames_oculus_2)
crv_17 = Curve(graft(cull))
eval = EvaluateCurve(Curve=reparameterize(crv_17), Parameter=0)  # -> Point, Tangent, Angle
Z_9 = UnitZ(Factor=1)
planar = Planar(Curve=crv_17)  # -> Planar, Plane, Deviation
xprod = CrossProduct(VectorA=eval.Tangent, VectorB=Z_9, Unitize=False)  # -> Vector, Length
amp = Amplitude(Vector=xprod.Vector, Amplitude=num_2)
planar_2 = Planar(Curve=crv_16)  # -> Planar, Plane, Deviation
rev = Reverse(Vector=amp)
offset = Offset(Curve=crv_16, Distance=division_6, Plane=planar_2.Plane, Corners=1)
darc_2 = DeconstructArc(Arc=crv_15)  # -> BasePlane, Radius, Angle
pt_2 = Point(darc_2.BasePlane)

crv_18 = Curve(graft(crv_16))
pl_origin = PlaneOrigin(Base=planar.Plane, Origin=eval.Point)
planesrf = PlaneSurface(Plane=pl_origin, XSize=dom_3, YSize=dom_3)
move_7 = Move(Geometry=planesrf, Motion=amp)  # -> Geometry, Transform
move_8 = Move(Geometry=planesrf, Motion=rev)  # -> Geometry, Transform
bbx = BrepBrep(BrepA=loft_2, BrepB=move_7.Geometry)  # -> Curves, Points
bbx_2 = BrepBrep(BrepA=loft_2, BrepB=move_8.Geometry)  # -> Curves, Points
pshift_2 = ShiftPaths(Data=bbx.Curves, Offset=-1)
pshift_3 = ShiftPaths(Data=bbx_2.Curves, Offset=-1)
relitem2 = RelativeItems(TreeA=pshift_2, TreeB=pshift_3, Offset="{0;1}(0)", WrapPaths=True, WrapItems=False)  # -> ItemA, ItemB
merge_6 = Merge(Data1=relitem2.ItemA, Data2=relitem2.ItemB)
end = EndPoints(Curve=merge_6)  # -> Start, End
flip_2 = FlipCurve(Curve=merge_6)  # -> Curve, Flag
pdecon = Deconstruct(Point=end.Start)  # -> XComponent, YComponent, ZComponent
pdecon_2 = Deconstruct(Point=end.End)  # -> XComponent, YComponent, ZComponent
larger_3 = LargerThan(FirstNumber=pdecon_2.ZComponent, SecondNumber=pdecon.ZComponent)  # -> LargerThan, OrEqualTo
dispatch = Dispatch(List=flip_2.Curve, DispatchPattern=larger_3.LargerThan)  # -> ListA, ListB
dispatch_2 = Dispatch(List=merge_6, DispatchPattern=larger_3.LargerThan)  # -> ListA, ListB
merge_7 = Merge(Data1=dispatch.ListA, Data2=dispatch_2.ListB)

explode_3 = Explode(Curve=crv_18, Recursive=True)  # -> Segments, Vertices
pshift_4 = ShiftPaths(Data=explode_3.Vertices, Offset=-1)
dist = Distance(PointA=pshift_4, PointB=pt_2)
sort = SortList(Keys=dist, ValuesA=pshift_4)  # -> Keys, ValuesA
item_2 = ListItem(List=reverse(sort.ValuesA), Index=0, Wrap=True)
end_2 = EndPoints(Curve=merge_7)  # -> Start, End
merge_8 = Merge(Data1=item_2, Data2=end_2.Start)
pline = PolyLine(Vertices=merge_8, Closed=True)
boundary = BoundarySurfaces(Edges=pline)
loft_4 = Loft(Curves=merge_7, Options={Adjust=False, Closed=False, LoftEnds=0, LoftSimp=0, LoftType=0, Rebuild=10, Refit=0.01})
merge_9 = Merge(Data1=boundary, Data2=loft_4)
join_2 = BrepJoin(Breps=merge_9)  # -> Breps, Closed

cull_5 = CullPattern(List=merge_4, CullPattern=larger_2.LargerThan)
cull_6 = CullPattern(List=merge_5, CullPattern=larger_2.LargerThan)
lng_2 = ListLength(List=cull_6)
division_7 = Division(A=lng_2, B=2)
int_11 = Integer(0)
subtraction_2 = Subtraction(A=division_7, B=1)
addition_2 = Addition(A=division_7, B=subtraction_2)
dom_6 = ConstructDomain(DomainStart=int_11, DomainEnd=subtraction_2)

dom_7 = ConstructDomain(DomainStart=division_7, DomainEnd=addition_2)

subset_3 = SubList(List=cull_5, Domain=dom_7, Wrap=True)  # -> List, Index
subset_4 = SubList(List=cull_6, Domain=dom_7, Wrap=True)  # -> List, Index

cluster_10 = Cluster_6(
    ellipse=crv_12,
    dome_surface=srf_4,
    panel_frames=subset_3.List,
    panel_center_pts=subset_4.List,
    reveal_width=neg,
    panel_thickness=panel_thickness)  # -> surfaces_2, curved_panels_2; disabled
brep_7 = Brep(cluster_10.curved_panels_2)
srf_8 = Surface(cluster_10.surfaces_2)

# ==== cluster Cluster
B = ClusterInput()
debrep = DeconstructBrep(Brep=B)  # -> Faces, Edges, Vertices
item = ListItem(List=debrep.Faces, Index=0, Wrap=True)
edges = BrepEdges(Brep=item)  # -> Naked, Interior, NonManifold
pshift = ShiftPaths(Data=edges.Naked, Offset=-1)
join = JoinCurves(Curves=pshift, Preserve=False)
pshift_2 = ShiftPaths(Data=join, Offset=-1)
darc = DeconstructArc(Arc=pshift_2)  # -> BasePlane, Radius, Angle
col_top_pts = Point(darc.BasePlane)
col_top_pts_2 = ClusterOutput(col_top_pts)

# ==== cluster Cluster_2
B = ClusterInput()
debrep = DeconstructBrep(Brep=B)  # -> Faces, Edges, Vertices
pshift = ShiftPaths(Data=debrep.Faces, Offset=-1)
int = Integer(24)
item = ListItem(List=pshift, Index=int, Wrap=True)
edges = BrepEdges(Brep=item)  # -> Naked, Interior, NonManifold
i = Index(0)
item_2 = ListItem(List=edges.Naked, Index=i, Wrap=True)
pshift_2 = ShiftPaths(Data=item_2, Offset=-1)
oculus_curve = Curve(pshift_2)
oculus_curve_2 = ClusterOutput(oculus_curve)

# ==== cluster Cluster_3
D = ClusterInput()
pshift = ShiftPaths(Data=D, Offset=-1)
pdecon = Deconstruct(Point=pshift)  # -> XComponent, YComponent, ZComponent
sort = SortList(Keys=pdecon.YComponent, ValuesA=pshift)  # -> Keys, ValuesA
item = ListItem(List=reverse(sort.ValuesA), Index=0, Wrap=True)
item_2 = ListItem(List=sort.ValuesA, Index=0, Wrap=True)
ln = Line(StartPoint=item_2, EndPoint=item)
len = Length(Curve=ln)
L = ClusterOutput(len)

# ==== cluster Cluster_4
qty_radials = ClusterInput()
r2 = ClusterInput()
scale_factor = ClusterInput()
ellipse_curve = ClusterInput()
oculus_curve = ClusterInput()
ellipse_curve_2 = Curve(ellipse_curve)
planar = Planar(Curve=ellipse_curve_2)  # -> Planar, Plane, Deviation
eval = EvaluateCurve(Curve=reparameterize(ellipse_curve_2), Parameter=0.5)  # -> Point, Tangent, Angle
scale_factor_2 = Number(scale_factor)
oculus_curve_2 = Curve(oculus_curve)
project = Project(Geometry=eval.Point, Plane=planar.Plane)  # -> Geometry, Transform
project_2 = Project(Geometry=oculus_curve_2, Plane=planar.Plane)  # -> Geometry, Transform
area = Area(Geometry=project_2.Geometry)  # -> Area, Centroid
division = Division(A=1, B=scale_factor_2)
scale = Scale(Geometry=project_2.Geometry, Center=area.Centroid, Factor=division)  # -> Geometry, Transform
xy = XYPlane(Origin=area.Centroid)
dist = Distance(PointA=project.Geometry, PointB=area.Centroid)
ellipse = Ellipse(Plane=xy, Radius1=dist, Radius2=r2)  # -> Ellipse, Focus1, Focus2
qty_radials_2 = Integer(qty_radials)
diagrid_ellipse = Curve(ellipse.Ellipse)
diagrid_ellipse_2 = ClusterOutput(diagrid_ellipse)
divide = DivideCurve(Curve=scale.Geometry, Count=qty_radials_2, Kinks=False)  # -> Points, Tangents, Parameters
divide_2 = DivideCurve(Curve=diagrid_ellipse, Count=qty_radials_2, Kinks=False)  # -> Points, Tangents, Parameters
ln = Line(StartPoint=divide.Points, EndPoint=divide_2.Points)
scale_2 = Scale(Geometry=ln, Center=area.Centroid, Factor=scale_factor_2)  # -> Geometry, Transform
pshift = ShiftPaths(Data=scale_2.Geometry, Offset=-1)
diagrid_radial = Line(pshift)
diagrid_radial_2 = ClusterOutput(diagrid_radial)

# ==== cluster Cluster_5
funnel_curves = ClusterInput()
funnel_curves_2 = Curve(funnel_curves)
loft_opt = LoftOptions(Closed=True, Adjust=False, Rebuild=0, Refit=0, Type=5)
reb = RebuildCurve(Curve=funnel_curves_2, Count=120, Tangents=False)
loft = Loft(Curves=reb, Options=loft_opt)
B = ClusterInput()
int = Integer(0)
dome_surface_basic = Surface(loft)
item = ListItem(List=reb, Index=int, Wrap=True)
bbx = BrepBrep(BrepA=loft, BrepB=B)  # -> Curves, Points
dome_surface_basic_2 = ClusterOutput(dome_surface_basic)
viewer = ParamViewer(bbx.Curves)
cull_i = CullIndex(List=viewer, Indices=int, Wrap=True)
branch = TreeBranch(Tree=bbx.Curves, Path=cull_i, MaintainPaths=True)
pshift = ShiftPaths(Data=branch, Offset=-1)
V = ClusterInput()
_1st_v = ClusterInput()
merge = Merge(Data1=item, Data2=pshift)
V_2 = Integer(V)
_1st_v_2 = Integer(_1st_v)
loft_2 = Loft(Curves=merge, Options=loft_opt)
U = ClusterInput()
subtraction = Subtraction(A=V_2, B=_1st_v_2)
U_2 = Integer(U)
dome_surface_uniform = Surface(loft_2)
sdivide = DivideSurface(Surface=loft_2, UCount=U_2, VCount=V_2)  # -> Points, Normals, Parameters
dom = ConstructDomain(DomainStart=_1st_v_2, DomainEnd=V_2)
dom_2 = ConstructDomain(DomainStart=0, DomainEnd=_1st_v_2)
dome_surface_uniform_2 = ClusterOutput(dome_surface_uniform)
subset = SubList(List=sdivide.Points, Domain=dom, Wrap=True)  # -> List, Index
subset_2 = SubList(List=sdivide.Points, Domain=dom_2, Wrap=True)  # -> List, Index
pshift_2 = ShiftPaths(Data=subset.List, Offset=-1)
pshift_3 = ShiftPaths(Data=subset_2.List, Offset=-1)
intcrv = Interpolate(Vertices=pshift_3, Degree=3, Periodic=False, KnotStyle=1)  # -> Curve, Length, Domain
diagrid_panels = DiagridPanels(PointArr=flatten(pshift_2), Rows=U_2, Columns=subtraction)  # -> out, Panel_Frames, Edge_Frames, CenPoints, CenPoints_Edge, Surfaces; inputs PointArr: list of Point3d
# ---------- diagrid_panels: VB ----------
    'Digarid Panels VB  [Digital [Sub]stance]
    'Written by Marios Tsiliakos on 12/1/2011
    '[Diagrid_Panels.VB] was written by Marios Tsiliakos on 26/6/2011 in grasshopper 8.04
    'This definition is for the pubic domain feel free to use it , share it and modify it, by providing proper citing.The author, Marios Tsiliakos of digitalsubstance.wordpress.com , makes no warranty, expressed or implied, as to the usefulness of the software and documentation for any purpose.If this tool is used for comerical purposes please notify the author.This work is licensed under a Creative Commons Attribution-Share Alike 3.0
    'for more information visit www.digitalsubstance.wordpress.com.
    If (PointArr Is Nothing) Then
      Print("Give me some points")
      Return
    End If

    Dim n As Int32
    Dim PointArray As New List(Of List(Of Point3d))


    For i As Int32= 0 To Rows
      Dim PointRows As New List(Of Point3d)

      For j As Int32= 0 To Columns
        Dim pts As New Point3d(PointArr(n))
        PointRows.Add(pts)
        n = n + 1
      Next

      PointArray.Add(PointRows)
    Next

    Dim Panels As New List(Of Polyline)
    Dim Rpanels As New List(Of Polyline)
    Dim Sur As New list( Of Surface)
    Dim Centroids As New List(Of Point3d)
    Dim CentroidsH As New List(Of Point3d)


    For i As Int32= 0 To Rows - 2 Step 2
      For j As Int32= 0 To Columns - 2 Step 2
        Dim pH As New Point3dList
        pH.add(PointArray(i + 1)(j))
        pH.add(PointArray(i + 2)(j + 1))
        pH.add(PointArray(i + 1)(j + 2))
        pH.add(PointArray(i)(j + 1))
        pH.add(PointArray(i + 1)(j))
        Dim P1 As New Polyline (pH)

        Panels.Add(P1)

        Dim Cp1 As New Point3d (((PointArray(i + 1)(j)).x + (PointArray(i + 1)(j + 2)).x) / 2, ((PointArray(i + 1)(j)).y + (PointArray(i + 1)(j + 2)).y) / 2, ((PointArray(i + 1)(j)).z + (PointArray(i + 1)(j + 2)).z) / 2)
        Centroids.Add(Cp1)


        Dim ptA As New Point3d(PointArray(i + 1)(j))
        Dim ptB As New Point3d(PointArray(i + 2)(j + 1))
        Dim ptC As New Point3d(PointArray(i + 1)(j + 2))
        Dim ptD As New Point3d(PointArray(i)(j + 1))

        Sur.add(Nurbssurface.CreateFromCorners(ptA, ptB, ptC, ptD))
      Next
    Next




    For i As Int32= 1 To Rows - 3 Step 2

      For j As Int32= 0 To Columns - 3  Step 2
        Dim pH As New Point3dList
        pH.add(PointArray(i + 1)(j + 1))
        pH.add(PointArray(i + 2)(j + 2))
        pH.add(PointArray(i + 1)(j + 3))
        pH.add(PointArray(i)(j + 2))
        pH.add(PointArray(i + 1)(j + 1))
        Dim P2 As New Polyline (pH)
        Panels.Add(P2)

        Dim Cp2 As New Point3d (((PointArray(i + 1)(j + 1)).x + (PointArray(i + 1)(j + 3)).x) / 2, ((PointArray(i + 1)(j + 1)).y + (PointArray(i + 1)(j + 3)).y) / 2, ((PointArray(i + 1)(j + 1)).z + (PointArray(i + 1)(j + 3)).z) / 2)
        Centroids.Add(Cp2)

        Dim ptA As New Point3d(PointArray(i + 1)(j + 1))
        Dim ptB As New Point3d(PointArray(i + 2)(j + 2))
        Dim ptC As New Point3d(PointArray(i + 1)(j + 3))
        Dim ptD As New Point3d(PointArray(i)(j + 2))

        Sur.add(Nurbssurface.CreateFromCorners(ptA, ptB, ptC, ptD))

      Next
    Next


    For i As Int32= 0 To Rows - ( Rows - 1) Step 2

      For j As Int32= 1 To Columns - 2 Step 2

        Dim pH As New Point3dList
        pH.add(PointArray(i)(j))
        pH.add(PointArray(i + 1)(j + 1))
        pH.add(PointArray(i)(j + 2))
        pH.add(PointArray(i)(j))

        Dim LeftRow As New Polyline (pH)
        Rpanels.Add(LeftRow)

        Dim D1 As New Point3d (((PointArray(i + 1)(j + 1)).x + (PointArray(i)(j + 2)).x) / 2, ((PointArray(i + 1)(j + 1)).y + (PointArray(i)(j + 2)).y) / 2, ((PointArray(i + 1)(j + 1)).z + (PointArray(i)(j + 2)).z) / 2)
        Dim Cp1 As New Point3D ((2 * D1.x + ((PointArray(i)(j)).x)) / 3, (2 * D1.y + ((PointArray(i)(j)).y)) / 3, (2 * D1.z + ((PointArray(i)(j)).z)) / 3)
        CentroidsH.Add(Cp1)

        Dim ptA As New Point3d(PointArray(i)(j))
        Dim ptB As New Point3d(PointArray(i + 1)(j + 1))
        Dim ptC As New Point3d(PointArray(i)(j + 2))
        Dim ptD As New Point3d(PointArray(i)(j))

        Sur.add(Nurbssurface.CreateFromCorners(ptA, ptB, ptC, ptD))

      Next
    Next

    For i As Int32= Rows - 2 To Rows - 2 Step 2
      For j As Int32= 0 To Columns - 3 Step 2

        Dim pH As New Point3dList
        pH.add(PointArray(i + 2)(j + 1))
        pH.add(PointArray(i + 2)(j + 3))
        pH.add(PointArray(i + 1)(j + 2))
        pH.add(PointArray(i + 2)(j + 1))

        Dim RightRow As New Polyline (pH)
        Rpanels.Add(RightRow)

        Dim D1 As New Point3d (((PointArray(i + 2)(j + 3)).x + (PointArray(i + 1)(j + 2)).x) / 2, ((PointArray(i + 2)(j + 3)).y + (PointArray(i + 1)(j + 2)).y) / 2, ((PointArray(i + 2)(j + 3)).z + (PointArray(i + 1)(j + 2)).z) / 2)
        Dim Cp1 As New Point3D ((2 * D1.x + ((PointArray(i + 2)(j + 1)).x)) / 3, (2 * D1.y + ((PointArray(i + 2)(j + 1)).y)) / 3, (2 * D1.z + ((PointArray(i + 2)(j + 1)).z)) / 3)
        CentroidsH.Add(Cp1)

        Dim ptA As New Point3d(PointArray(i + 2)(j + 1))
        Dim ptB As New Point3d(PointArray(i + 2)(j + 3))
        Dim ptC As New Point3d(PointArray(i + 1)(j + 2))
        Dim ptD As New Point3d(PointArray(i + 2)(j + 1))

        Sur.add(Nurbssurface.CreateFromCorners(ptA, ptB, ptC, ptD))
      Next
    Next

    For i As Int32= 1 To Rows - 2 Step 2
      For j As Int32 = 0 To Columns - (Columns - 1) Step 2

        Dim pH As New Point3dList
        pH.add(PointArray(i)(j))
        pH.add(PointArray(i + 2)(j))
        pH.add(PointArray(i + 1)(j + 1))
        pH.add(PointArray(i)(j))

        Dim URow As New Polyline (pH)
        Rpanels.Add(URow)

        Dim D1 As New Point3d (((PointArray(i + 2)(j)).x + (PointArray(i + 1)(j + 1)).x) / 2, ((PointArray(i + 2)(j)).y + (PointArray(i + 1)(j + 1)).y) / 2, ((PointArray(i + 2)(j)).z + (PointArray(i + 1)(j + 1)).z) / 2)
        Dim Cp1 As New Point3D ((2 * D1.x + ((PointArray(i)(j)).x)) / 3, (2 * D1.y + ((PointArray(i)(j)).y)) / 3, (2 * D1.z + ((PointArray(i)(j)).z)) / 3)
        CentroidsH.Add(Cp1)

        Dim ptA As New Point3d(PointArray(i)(j))
        Dim ptB As New Point3d(PointArray(i + 2)(j))
        Dim ptC As New Point3d(PointArray(i + 1)(j + 1))
        Dim ptD As New Point3d(PointArray(i)(j))

        Sur.add(Nurbssurface.CreateFromCorners(ptA, ptB, ptC, ptD))
      Next
    Next

    For i As Int32= 1 To Rows - 2 Step 2
      For j As Int32 = Columns - 3 To Columns - 2 Step 3

        Dim pH As New Point3dList
        pH.add(PointArray(i)(j + 3))
        pH.add(PointArray(i + 2)(j + 3))
        pH.add(PointArray(i + 1)(j + 2))
        pH.add(PointArray(i)(j + 3))

        Dim URow As New Polyline (pH)
        Rpanels.Add(URow)

        Dim D1 As New Point3d (((PointArray(i + 2)(j + 3)).x + (PointArray(i + 1)(j + 2)).x) / 2, ((PointArray(i + 2)(j + 3)).y + (PointArray(i + 1)(j + 2)).y) / 2, ((PointArray(i + 2)(j + 3)).z + (PointArray(i + 1)(j + 2)).z) / 2)
        Dim Cp1 As New Point3D ((2 * D1.x + ((PointArray(i)(j + 3)).x)) / 3, (2 * D1.y + ((PointArray(i)(j + 3)).y)) / 3, (2 * D1.z + ((PointArray(i)(j + 3)).z)) / 3)
        CentroidsH.Add(Cp1)

        Dim ptA As New Point3d(PointArray(i)(j + 3))
        Dim ptB As New Point3d(PointArray(i + 2)(j + 3))
        Dim ptC As New Point3d(PointArray(i + 1)(j + 2))
        Dim ptD As New Point3d(PointArray(i)(j + 3))

        Sur.add(Nurbssurface.CreateFromCorners(ptA, ptB, ptC, ptD))
      Next
    Next


    For i As Int32= 0 To Rows - (Rows - 1) Step 2
      For j As Int32 = 0 To Columns - (Columns - 1) Step 2

        Dim pH As New Point3dList
        pH.add(PointArray(i)(j))
        pH.add(PointArray(i + 1)(j))
        pH.add(PointArray(i)(j + 1))
        pH.add(PointArray(i)(j))

        Dim URow As New Polyline (pH)
        Rpanels.Add(URow)

        Dim D1 As New Point3d (((PointArray(i + 1)(j)).x + (PointArray(i)(j + 1)).x) / 2, ((PointArray(i + 1)(j)).y + (PointArray(i)(j + 1)).y) / 2, ((PointArray(i + 1)(j)).z + (PointArray(i)(j + 1)).z) / 2)
        Dim Cp1 As New Point3D ((2 * D1.x + ((PointArray(i)(j)).x)) / 3, (2 * D1.y + ((PointArray(i)(j)).y)) / 3, (2 * D1.z + ((PointArray(i)(j)).z)) / 3)
        CentroidsH.Add(Cp1)

        Dim ptA As New Point3d(PointArray(i)(j))
        Dim ptB As New Point3d(PointArray(i + 1)(j))
        Dim ptC As New Point3d(PointArray(i)(j + 1))
        Dim ptD As New Point3d(PointArray(i)(j))

        Sur.add(Nurbssurface.CreateFromCorners(ptA, ptB, ptC, ptD))
      Next
    Next



    For i As Int32= Rows - 2 To Rows - 1 Step 2
      For j As Int32 = 0 To Columns - (Columns - 1) Step 2

        Dim pH As New Point3dList
        pH.add(PointArray(i + 1)(j))
        pH.add(PointArray(i + 2)(j))
        pH.add(PointArray(i + 2)(j + 1))
        pH.add(PointArray(i + 1)(j))

        Dim URow As New Polyline (pH)
        Rpanels.Add(URow)

        Dim D1 As New Point3d (((PointArray(i + 2)(j)).x + (PointArray(i + 2)(j + 1)).x) / 2, ((PointArray(i + 2)(j)).y + (PointArray(i + 2)(j + 1)).y) / 2, ((PointArray(i + 2)(j)).z + (PointArray(i + 2)(j + 1)).z) / 2)
        Dim Cp1 As New Point3D ((2 * D1.x + ((PointArray(i + 1)(j)).x)) / 3, (2 * D1.y + ((PointArray(i + 1)(j)).y)) / 3, (2 * D1.z + ((PointArray(i + 1)(j)).z)) / 3)
        CentroidsH.Add(Cp1)

        Dim ptA As New Point3d(PointArray(i + 1)(j))
        Dim ptB As New Point3d(PointArray(i + 2)(j))
        Dim ptC As New Point3d(PointArray(i + 2)(j + 1))
        Dim ptD As New Point3d(PointArray(i + 1)(j))

        Sur.add(Nurbssurface.CreateFromCorners(ptA, ptB, ptC, ptD))
      Next
    Next

    For i As Int32= Rows - 2 To Rows - 1 Step 2
      For j As Int32 = Columns - 2 To Columns - 1 Step 2

        Dim pH As New Point3dList
        pH.add(PointArray(i + 1)(j + 2))
        pH.add(PointArray(i + 2)(j + 2))
        pH.add(PointArray(i + 2)(j + 1))
        pH.add(PointArray(i + 1)(j + 2))

        Dim URow As New Polyline (pH)
        Rpanels.Add(URow)

        Dim D1 As New Point3d (((PointArray(i + 2)(j + 2)).x + (PointArray(i + 2)(j + 1)).x) / 2, ((PointArray(i + 2)(j + 2)).y + (PointArray(i + 2)(j + 1)).y) / 2, ((PointArray(i + 2)(j + 2)).z + (PointArray(i + 2)(j + 1)).z) / 2)
        Dim Cp1 As New Point3D ((2 * D1.x + ((PointArray(i + 1)(j + 2)).x)) / 3, (2 * D1.y + ((PointArray(i + 1)(j + 2)).y)) / 3, (2 * D1.z + ((PointArray(i + 1)(j + 2)).z)) / 3)
        CentroidsH.Add(Cp1)

        Dim ptA As New Point3d(PointArray(i + 1)(j + 2))
        Dim ptB As New Point3d(PointArray(i + 2)(j + 2))
        Dim ptC As New Point3d(PointArray(i + 2)(j + 1))
        Dim ptD As New Point3d(PointArray(i + 1)(j + 2))

        Sur.add(Nurbssurface.CreateFromCorners(ptA, ptB, ptC, ptD))
      Next
    Next


    For i As Int32= 0 To Rows - (Rows - 1) Step 2
      For j As Int32 = Columns - 2 To Columns - 1 Step 2

        Dim pH As New Point3dList
        pH.add(PointArray(i)(j + 1))
        pH.add(PointArray(i + 1)(j + 2))
        pH.add(PointArray(i)(j + 2))
        pH.add(PointArray(i)(j + 1))

        Dim URow As New Polyline (pH)
        Rpanels.Add(URow)

        Dim D1 As New Point3d (((PointArray(i + 1)(j + 2)).x + (PointArray(i)(j + 2)).x) / 2, ((PointArray(i + 1)(j + 2)).y + (PointArray(i)(j + 2)).y) / 2, ((PointArray(i + 1)(j + 2)).z + (PointArray(i)(j + 2)).z) / 2)
        Dim Cp1 As New Point3D ((2 * D1.x + ((PointArray(i)(j + 1)).x)) / 3, (2 * D1.y + ((PointArray(i)(j + 1)).y)) / 3, (2 * D1.z + ((PointArray(i)(j + 1)).z)) / 3)
        CentroidsH.Add(Cp1)

        Dim ptA As New Point3d(PointArray(i)(j + 1))
        Dim ptB As New Point3d(PointArray(i + 1)(j + 2))
        Dim ptC As New Point3d(PointArray(i)(j + 2))
        Dim ptD As New Point3d(PointArray(i)(j + 1))

        Sur.add(Nurbssurface.CreateFromCorners(ptA, ptB, ptC, ptD))
      Next
    Next

    Panel_Frames = Panels
    Edge_Frames = Rpanels
    CenPoints = Centroids
    CenPoints_Edge = CentroidsH
    Surfaces = Sur
# ---------- end diagrid_panels ----------
funnel_curves_3 = Curve(intcrv.Curve)
lng = ListLength(List=flatten(diagrid_panels.Edge_Frames))
subtraction_2 = Subtraction(A=subtraction, B=2)
subtraction_3 = Subtraction(A=lng, B=subtraction_2)
subtraction_4 = Subtraction(A=subtraction_3, B=4)
division = Division(A=subtraction_2, B=2)
division_2 = Division(A=subtraction_4, B=2)
int_2 = Integer(2)
merge_2 = Merge(Data1=division, Data2=division, Data3=division_2, Data4=division_2, Data5=int_2)
panel_frames = ClusterOutput(diagrid_panels.Panel_Frames)
edge_frames = ClusterOutput(diagrid_panels.Edge_Frames)
cenpoints = ClusterOutput(diagrid_panels.CenPoints)
cenpoints_edge = ClusterOutput(diagrid_panels.CenPoints_Edge)
surfaces = ClusterOutput(diagrid_panels.Surfaces)
funnel_curves_4 = ClusterOutput(funnel_curves_3)
partition = PartitionList(List=flatten(diagrid_panels.Edge_Frames), Size=merge_2)
viewer_2 = ParamViewer(partition)
item_2 = ListItem(List=viewer_2, Index=0, Wrap=True)
item_3 = ListItem(List=viewer_2, Index=1, Wrap=True)
item_4 = ListItem(List=viewer_2, Index=2, Wrap=True)
item_5 = ListItem(List=viewer_2, Index=3, Wrap=True)
item_6 = ListItem(List=viewer_2, Index=4, Wrap=True)
branch_2 = TreeBranch(Tree=partition, Path=item_2, MaintainPaths=True)  # -> graft(Branch)
branch_3 = TreeBranch(Tree=partition, Path=item_3, MaintainPaths=True)  # -> graft(Branch)
branch_4 = TreeBranch(Tree=partition, Path=item_4, MaintainPaths=True)  # -> flatten(Branch)
branch_5 = TreeBranch(Tree=partition, Path=item_5, MaintainPaths=True)  # -> graft(Branch)
branch_6 = TreeBranch(Tree=partition, Path=item_6, MaintainPaths=True)
path_mapper = PathMapper(branch_3, source="{A;B;C}", target="{path_index}")
path_mapper_2 = PathMapper(branch_2, source="{A;B;C}", target="{path_index}")
boundary = BoundarySurfaces(Edges=branch_6)
sunion = SolidUnion(Breps=boundary)
merge_3 = Merge(Data1=path_mapper_2, Data2=path_mapper)
edges = BrepEdges(Brep=sunion)  # -> Naked, Interior, NonManifold
boundary_2 = BoundarySurfaces(Edges=merge_3)
join = JoinCurves(Curves=edges.Naked, Preserve=False)  # -> flatten(Curves)
sunion_2 = SolidUnion(Breps=boundary_2)
merge_4 = Merge(Data1=branch_4, Data2=join)
edges_2 = BrepEdges(Brep=sunion_2)  # -> Naked, Interior, NonManifold
join_2 = JoinCurves(Curves=edges_2.Naked, Preserve=False)  # -> flatten(Curves)
explode = Explode(Curve=join_2, Recursive=True)  # -> Segments, Vertices
explode_2 = Explode(Curve=merge_4, Recursive=True)  # -> Segments, Vertices
cullpt = CullDuplicates(Points=explode.Vertices, Tolerance=0.1, CullMode=3)  # -> Points, Indices, Valence
cullpt_2 = CullDuplicates(Points=explode_2.Vertices, Tolerance=0.1, CullMode=3)  # -> Points, Indices, Valence
edge_frames_oculus = Curve(merge_4)
edge_frames_seam = Curve(join_2)
avr = Average(Input=cullpt.Points)  # -> flatten(ArithmeticMean)
avr_2 = Average(Input=cullpt_2.Points)  # -> flatten(ArithmeticMean)
edge_frames_oculus_2 = ClusterOutput(edge_frames_oculus)
edge_frames_seam_2 = ClusterOutput(edge_frames_seam)
edge_center_pts_seam = Point(avr)
edge_center_pts_oculus = Point(avr_2)
edge_center_pts_seam_2 = ClusterOutput(edge_center_pts_seam)
edge_center_pts_oculus_2 = ClusterOutput(edge_center_pts_oculus)

# ==== cluster Cluster_6
ellipse = ClusterInput()
dome_surface = ClusterInput()
panel_frames = ClusterInput()
panel_center_pts = ClusterInput()
reveal_width = ClusterInput()
panel_thickness = ClusterInput()
panel_frames_2 = Curve(flatten(panel_frames))
panel_center_pts_2 = Point(flatten(panel_center_pts))
dome_surface_2 = Surface(dome_surface)
pt = Point(graft(panel_center_pts_2))
srf_cp = SurfaceClosestPoint(Point=pt, Surface=dome_surface_2)  # -> Point, UVPoint, Distance
crv = Curve(graft(panel_frames_2))
evalsrf = EvaluateSurface(Surface=dome_surface_2, Point=srf_cp.UVPoint)  # -> Point, Normal, Frame
pl = PlaneNormal(Origin=evalsrf.Point, ZAxis=evalsrf.Normal)
project = Project(Geometry=crv, Plane=pl)  # -> Geometry, Transform
reveal_width_2 = Number(reveal_width)
division = Division(A=reveal_width_2, B=2)
offset = Offset(Curve=project.Geometry, Distance=division, Plane=pl, Corners=1)
pshift = ShiftPaths(Data=offset, Offset=-1)
project_2 = Project(Curve=crv, Brep=dome_surface_2, Direction=pl)
ellipse_2 = Curve(ellipse)
pshift_2 = ShiftPaths(Data=project_2, Offset=-1)
disc = Discontinuity(Curve=pshift_2, Level=1)  # -> Points, Parameters
Z = UnitZ(Factor=-10000)
Z_2 = UnitZ(Factor=40000)
pshift_3 = ShiftPaths(Data=disc.Parameters, Offset=-1)
move = Move(Geometry=ellipse_2, Motion=Z)  # -> Geometry, Transform
shatter = Shatter(Curve=pshift_2, Parameters=pshift_3)
extr = Extrude(Base=move.Geometry, Direction=Z_2)
pshift_4 = ShiftPaths(Data=shatter, Offset=-1)
cap = CapHoles(Brep=extr)
reb = RebuildCurve(Curve=pshift_4, Count=10, Tangents=False)
item = ListItem(List=reb, Index=2, Wrap=True)
item_2 = ListItem(List=reb, Index=3, Wrap=True)
item_3 = ListItem(List=reb, Index=0, Wrap=True)
item_4 = ListItem(List=reb, Index=1, Wrap=True)
merge = Merge(Data1=item_3, Data2=item)
merge_2 = Merge(Data1=item_4, Data2=item_2)
vec = Vector(evalsrf.Normal)
panel_thickness_2 = Number(panel_thickness)
netsurf = NetworkSurface(CurvesU=merge, CurvesV=merge_2, Continuity=2)
amp = Amplitude(Vector=vec, Amplitude=panel_thickness_2)

srf = Surface(netsurf)
project_3 = Project(Curve=ellipse_2, Brep=srf, Direction=Vector(0, 0, 1))
pshift_5 = ShiftPaths(Data=project_3, Offset=-1)
srfsplit = SurfaceSplit(Surface=srf, Curves=pshift_5)
pshift_6 = ShiftPaths(Data=srfsplit, Offset=-1)
area = Area(Geometry=pshift_6)  # -> Area, Centroid
brepinc = PointInBrep(Brep=cap, Point=area.Centroid, Strict=False)
cull = CullPattern(List=pshift_6, CullPattern=brepinc)
extr_2 = Extrude(Base=cull, Direction=amp)  # disabled

surfaces = Surface(cull)
curved_panels = Brep(extr_2)
surfaces_2 = ClusterOutput(surfaces)
curved_panels_2 = ClusterOutput(curved_panels)

# ==== cluster Cluster_7
oculus_upturn = ClusterInput()
oculus_downturn = ClusterInput()
minor_ellipse = ClusterInput()
upturn_taper_width = ClusterInput()
upturn_taper_height = ClusterInput()
oculus_xy_offset = ClusterInput()
qty_basic_loft_curves = ClusterInput()
upturn_taper_width_2 = Integer(upturn_taper_width)
upturn_taper_height_2 = Integer(upturn_taper_height)
neg = Negative(Value=upturn_taper_width_2)
Z = UnitZ(Factor=upturn_taper_height_2)
dome_surface_basic = ClusterInput()
dome_surface_basic_2 = Surface(dome_surface_basic)
funnel_curve_div_length = ClusterInput()
funnel_curve_div_length_2 = Integer(funnel_curve_div_length)

oculus_upturn_2 = Circle(oculus_upturn)

offset = Offset(Curve=oculus_upturn_2, Distance=neg, Plane=PlaneXY(0, 0, 0), Corners=1)
pshift = ShiftPaths(Data=offset, Offset=-1)
darc = DeconstructArc(Arc=oculus_upturn_2)  # -> BasePlane, Radius, Angle
pt = Point(darc.BasePlane)
move = Move(Geometry=pt, Motion=Z)  # -> Geometry, Transform

oculus_downturn_2 = Circle(oculus_downturn)
Z_2 = UnitZ(Factor=1)
rev = Reverse(Vector=Z_2)
int = Integer(1000)
int_2 = Integer(60000)

minor_ellipse_2 = Curve(minor_ellipse)
oculus_xy_offset_2 = Number(oculus_xy_offset)
qty_basic_loft_curves_2 = Integer(qty_basic_loft_curves)
offset_2 = Offset(Curve=oculus_downturn_2, Distance=oculus_xy_offset_2, Plane=PlaneXY(0, 0, 0), Corners=1)
darc_2 = DeconstructArc(Arc=oculus_downturn_2)  # -> BasePlane, Radius, Angle
pshift_2 = ShiftPaths(Data=offset_2, Offset=-1)
divide = DivideCurve(Curve=minor_ellipse_2, Count=qty_basic_loft_curves_2, Kinks=False)  # -> Points, Tangents, Parameters
divide_2 = DivideCurve(Curve=pshift_2, Count=qty_basic_loft_curves_2, Kinks=False)  # -> Points, Tangents, Parameters
Z_3 = UnitZ(Factor=1)
pt_2 = Point(darc_2.BasePlane)
pshift_3 = ShiftPaths(Data=divide.Points, Offset=-1)
pshift_4 = ShiftPaths(Data=divide_2.Tangents, Offset=-1)
xprod = CrossProduct(VectorA=pshift_4, VectorB=Z_3, Unitize=False)  # -> Vector, Length
int_3 = Integer(70000)
line = LineSDL(Start=pshift_3, Direction=xprod.Vector, Length=70000)
line_2 = LineSDL(Start=pt_2, Direction=xprod.Vector, Length=80000)
Z_4 = UnitZ(Factor=int_3)
extr = Extrude(Base=line, Direction=Z_4)
flip = FlipCurve(Curve=line_2)  # -> Curve, Flag
Z_5 = UnitZ(Factor=-70000)
Z_6 = UnitZ(Factor=100000)
move_2 = Move(Geometry=flip.Curve, Motion=Z_5)  # -> Geometry, Transform
extr_2 = Extrude(Base=move_2.Geometry, Direction=Z_6)
v_planes_ellipse = Surface(extr)
v_planes_center = Surface(extr_2)

divide_3 = DivideCurve(Curve=oculus_downturn_2, Count=qty_basic_loft_curves_2, Kinks=False)  # -> Points, Tangents, Parameters
pshift_5 = ShiftPaths(Data=divide_3.Points, Offset=-1)
line_3 = LineSDL(Start=pshift_5, Direction=rev, Length=int)
bbx = BrepBrep(BrepA=dome_surface_basic_2, BrepB=v_planes_ellipse)  # -> Curves, Points
line_4 = Line(graft(line_3))
ext = ExtendCurve(Curve=bbx.Curves, Type=0, Start=int_2, End=0)
blendc = BlendCurve(CurveA=bbx.Curves, CurveB=line_4, BulgeA=Slider(0.8, range=0..1), BulgeB=Slider(0.2, range=0..1), Continuity=1)
merge = Merge(Data1=ext, Data2=blendc)
crv = Curve(ext)
planar = Planar(Curve=crv)  # -> Planar, Plane, Deviation
join = JoinCurves(Curves=merge, Preserve=False)
offset_3 = Offset(Curve=crv, Distance=900, Plane=planar.Plane, Corners=1)
pshift_6 = ShiftPaths(Data=join, Offset=-2)
pshift_7 = ShiftPaths(Data=offset_3, Offset=-1)
flip_2 = FlipCurve(Curve=pshift_6)  # -> Curve, Flag
funnel_curves_downturn = Curve(flip_2.Curve)

v_planes_center_2 = ClusterOutput(v_planes_center)
funnel_curves_downturn_2 = Curve(funnel_curves_downturn)
divlength = DivideLength(Curve=funnel_curves_downturn_2, Length=funnel_curve_div_length_2)  # -> Points, Tangents, Parameters
lng = ListLength(List=divlength.Points)  # -> flatten(Length)

qty_basic_loft_curves_3 = Integer(qty_basic_loft_curves_2)
divide_4 = DivideCurve(Curve=pshift, Count=qty_basic_loft_curves_3, Kinks=False)  # -> Points, Tangents, Parameters
pshift_8 = ShiftPaths(Data=divide_4.Points, Offset=-1)
intersections = Curve(pshift_7)

ln = Line(StartPoint=pshift_8, EndPoint=move.Geometry)

devec = DeconstructVector(Vector=ln)  # -> XComponent, YComponent, ZComponent
vec = VectorXYZ(XComponent=devec.XComponent, YComponent=devec.YComponent, ZComponent=0)  # -> Vector, Length
angle = Angle(VectorA=ln, VectorB=vec.Vector)  # -> Angle, Reflex
deg = Degrees(Radians=angle.Angle)
panel = Panel(deg)
line_5 = Line(graft(ln))
blendc_2 = BlendCurve(CurveA=intersections, CurveB=line_5, BulgeA=Slider(0.4, range=0..1), BulgeB=Slider(0.4, range=0..1), Continuity=2)

item = ListItem(List=deg, Index=0, Wrap=True)
oculus_slope = Number(item)
merge_2 = Merge(Data1=intersections, Data2=blendc_2)

join_2 = JoinCurves(Curves=merge_2, Preserve=False)
pshift_9 = ShiftPaths(Data=join_2, Offset=-2)
flip_3 = FlipCurve(Curve=pshift_9)  # -> Curve, Flag
funnel_curves_upturn = Curve(flip_3.Curve)

funnel_curves_upturn_2 = Curve(funnel_curves_upturn)
divlength_2 = DivideLength(Curve=funnel_curves_upturn_2, Length=funnel_curve_div_length_2)  # -> Points, Tangents, Parameters
lng_2 = ListLength(List=divlength_2.Points)  # -> flatten(Length)
merge_3 = Merge(Data1=lng_2, Data2=lng)
bnd = Bounds(Numbers=merge_3)
dedomain = DeconstructDomain(Domain=bnd)  # -> Start, End
dom = ConstructDomain(DomainStart=0, DomainEnd=expr("x - 1", dedomain.Start))
subset = SubList(List=divlength.Points, Domain=dom, Wrap=True)  # -> List, Index
subset_2 = SubList(List=divlength_2.Points, Domain=dom, Wrap=True)  # -> List, Index
pshift_10 = ShiftPaths(Data=subset.List, Offset=-1)
pshift_11 = ShiftPaths(Data=subset_2.List, Offset=-1)
intcrv = Interpolate(Vertices=pshift_10, Degree=3, Periodic=False, KnotStyle=1)  # -> Curve, Length, Domain
intcrv_2 = Interpolate(Vertices=pshift_11, Degree=3, Periodic=False, KnotStyle=1)  # -> Curve, Length, Domain
ln_2 = Line(StartPoint=pshift_11, EndPoint=pshift_10)
funnel_curves_upturn_3 = Curve(flatten(intcrv_2.Curve))
funnel_curves_downturn_3 = Curve(flatten(intcrv.Curve))
merge_4 = Merge(Data1=intcrv_2.Curve, Data2=intcrv.Curve)
funnel_curves_upturn_4 = ClusterOutput(funnel_curves_upturn_3)
funnel_curves_downturn_4 = ClusterOutput(funnel_curves_downturn_3)
oculus_slope_2 = ClusterOutput(oculus_slope)
loft = Loft(Curves=merge_4, Options={Adjust=False, Closed=False, LoftEnds=0, LoftSimp=0, LoftType=0, Rebuild=10, Refit=0.01})
viewer = ParamViewer(loft)
item_2 = ListItem(List=viewer, Index=Slider(16, range=0..31), Wrap=True)
branch = TreeBranch(Tree=loft, Path=item_2, MaintainPaths=True)
branch_2 = TreeBranch(Tree=ln_2, Path=item_2, MaintainPaths=True)

# ==== cluster Cluster_8
B = ClusterInput()
glazing_height = ClusterInput()
debrep = DeconstructBrep(Brep=B)  # -> Faces, Edges, Vertices
glazing_height_2 = Integer(glazing_height)
pshift = ShiftPaths(Data=debrep.Faces, Offset=-1)
Z = UnitZ(Factor=glazing_height_2)
item = ListItem(List=pshift, Index=4, Wrap=True)
move = Move(Geometry=item, Motion=Z)  # -> Geometry, Transform
edges = BrepEdges(Brep=move.Geometry)  # -> Naked, Interior, NonManifold
pshift_2 = ShiftPaths(Data=edges.Naked, Offset=-1)
item_2 = ListItem(List=pshift_2, Index=0, Wrap=True)
item_3 = ListItem(List=pshift_2, Index=1, Wrap=True)
merge = Merge(Data1=item_2, Data2=item_3)
join = JoinCurves(Curves=merge, Preserve=False)
pshift_3 = ShiftPaths(Data=join, Offset=-1)
seam = Seam(Curve=reparameterize(pshift_3), Seam=0.5)
curb_ellipse = Curve(seam)
curb_ellipse_2 = ClusterOutput(curb_ellipse)
